# Grasshopper definition osm workflow test.gh (Grasshopper 1.0.8)
# plug-ins: Heteroptera, Urbano2, Pufferfish, Human, LadybugGrasshopper

path = FilePath("C:\Users\Param\OneDrive - Ananke-eidos\Documents\Ananke Eidos Studio\VS code\Rhino Plugins\OSM + Overture downloader\south-wales-package-4\51.5476_51.3709_-3.1483_-3.6626_project_setting.json")
file = ReadFile(File=path, PerLineParse=False)
deconstruct_project_setting = DeconstructProjectSetting(ProjectSetting=file)  # -> Directory, Boundary, Granularity, DataLayers, DataFiles, CoordinateReference
create_project_setting = CreateProjectSetting(
    Directory=deconstruct_project_setting.Directory,
    Boundary=deconstruct_project_setting.Boundary,
    Granularity=deconstruct_project_setting.Granularity,
    DataLayers=["osm", "census", "elevation", "overture"],
    CoordinateReference=deconstruct_project_setting.CoordinateReference)
text = Text(file)
falsestart = LBFalseStartToggle(False)

import_green_spaces = ImportGreenSpaces(ProjectSetting=text, DataSource="osm", Terrain=falsestart)  # -> GreenSpaces, Trees
boundary = BoundarySurfaces(Edges=import_green_spaces.GreenSpaces)
preview = CustomPreview(Geometry=boundary, Material=ColourSwatch(SwatchColor=RGB(119, 156, 107)))

import_public_transits = ImportPublicTransits(ProjectSetting=text, DataSource="osm", Terrain=falsestart)  # -> TransitLines, TransitStops
urbano_pt = UrbanoPt(import_public_transits.TransitStops)
pt = Point(urbano_pt)
cir = Circle(Plane=pt, Radius=10)
previewlw = CustomPreviewLineweights(
    Geometry=import_public_transits.TransitLines,
    Shader=ColourSwatch(SwatchColor=RGB(77, 116, 163)),
    Thickness=Slider(1.48, range=1..2),
    Absolute=False)
boundary_2 = BoundarySurfaces(Edges=cir)
preview_2 = CustomPreview(Geometry=boundary_2, Material=ColourSwatch(SwatchColor=RGB(168, 42, 42)))

# ----
# Visualize streets by type (based on OSM tags)
import_streets = ImportStreets(ProjectSetting=text, DataSource="osm", Terrain=falsestart)
lookup_metadata = LookupMetadata(MetadataGeometry=import_streets, SearchKey="highway")
previewlw_2 = CustomPreviewLineweights(
    Geometry=import_streets,
    Shader=ColourSwatch(SwatchColor=RGB(166, 166, 166)),
    Thickness=Slider(1, range=1..2),
    Absolute=False)
urbano_gradient = UrbanoGradient(Reverse=Button(), stops=[0: RGB(0, 0, 0), 0.133: RGB(87, 86, 87), 1: RGB(255, 255, 255)])
map_settings = MapSettings(Gradient=urbano_gradient, Legend=False, LegendTitle="OSM Street Tag", Label=False, LinewidthRange="0.2 to 1")
draw_map = DrawMap(Geometries=import_streets, Values=lookup_metadata, MapSettings=map_settings)

import_buildings = ImportBuildings(ProjectSetting=text, DataSource="osm", Terrain=falsestart)  # -> _2DFootprints, _3DMeshes
lookup_metadata_2 = LookupMetadata(MetadataGeometry=import_buildings._3DMeshes, SearchKey="building")
urbano_gradient_2 = UrbanoGradient(
    Reverse=Button(),
    stops=[0: RGB(243, 57, 0), 0.1: RGB(247, 159, 20), 0.2: RGB(220, 237, 32), 0.3: RGB(79, 186, 8), 0.4: RGB(18, 178, 90), 0.5: RGB(1, 192, 229), 0.6: RGB(39, 72, 161), 0.7: RGB(103, 0, 120), 0.8: RGB(210, 0, 118), 0.9: RGB(236, 27, 60), 1: RGB(243, 57, 0)])
previewlw_3 = CustomPreviewLineweights(
    Geometry=import_buildings._2DFootprints,
    Shader=ColourSwatch(SwatchColor=RGB(41, 112, 150)),
    Thickness=Slider(1, range=1..2),
    Absolute=False)
mesh = Mesh(import_buildings._3DMeshes)
map_settings_2 = MapSettings(Gradient=urbano_gradient_2, Legend=True, LegendTitle="OSM Building Tag", Label=False)
draw_map_2 = DrawMap(Geometries=mesh, Values=lookup_metadata_2, MapSettings=map_settings_2)

import_terrain = ImportTerrain(ProjectSetting=text, Colored=True)
demesh = DeconstructMesh(Mesh=import_terrain)  # -> Vertices, Faces, Colours, Normals
extremes = MinMax(Number=demesh.Colours)  # -> Minimum, Maximum
bnd = Bounds(Numbers=demesh.Colours)
urbano_gradient_3 = UrbanoGradient(
    Reverse=Toggle(False),
    stops=[0: RGB(234, 38, 0), 0.25: RGB(224, 156, 45), 0.5: RGB(134, 201, 40), 0.76: RGB(44, 193, 219), 1: RGB(44, 100, 212)])
slideindom = SlideWithinDomain(Domain=bnd, Factor=Slider(0.6, range=0..1))
map_settings_3 = MapSettings(Gradient=urbano_gradient_3, Max=slideindom, Min=extremes.Minimum, Legend=False, Label=False)
draw_map_3 = DrawMap(Geometries=import_terrain, Values=bnd, MapSettings=map_settings_3)
